# Dynamo graph ColumnCost-EXC2RVT.dyn "DFBP_03_Import Parameter Data from Excel" (Dynamo 2.0.2.6826)

# group: Get All Structural Columns
categories = Categories(index=496)  # graph input
all_elements_of_category = ElementsOfCategory(Category=categories)

# group: Get Structural Column Mark Values From Revit
revit_parameter_to_match = StringInput("Mark")  # graph input
getParameterValueByName = Element.GetParameterValueByName(element=all_elements_of_category, parameterName=revit_parameter_to_match)

# group: Read Excel Data
file_path = Filename("..\Dynamo\DFBP_01_Export_Element_Parameters_to_Excel\Deneme.xslx")  # graph input
fromPath = FileObject(path=file_path)  # "File.FromPath"
excel_worksheet_name = StringInput("Sheet 1")  # graph input
read_excel_data_as_text = BoolSelector(false)  # graph input
importExcel = Data.ImportExcel(file=fromPath, sheetName=excel_worksheet_name, readAsStrings=read_excel_data_as_text)
code_block = CodeBlock { 0; }
removeItemAtIndex = List.RemoveItemAtIndex(list=importExcel, indices=code_block)
watch = Watch(importExcel)

# group: Get Structural Column Mark From Excel
transpose = List.Transpose(lists=removeItemAtIndex)
excel_column_to_match_start_at_0 = DoubleInput(0)  # graph input
getItemAtIndex = List.GetItemAtIndex(list=transpose, index=excel_column_to_match_start_at_0)

# group: Sort Only Structural Columns in Excel List and Per Excel Order
firstIndexOf = List.FirstIndexOf(list=getParameterValueByName, item=getItemAtIndex)
getItemAtIndex_2 = List.GetItemAtIndex(list=all_elements_of_category, index=firstIndexOf)

# group: Get Cost From Excel
transpose_2 = List.Transpose(lists=removeItemAtIndex)
excel_column_to_import_start_at = DoubleInput(3)  # "Excel Column to Import (Start at 0)"; graph input
getItemAtIndex_3 = List.GetItemAtIndex(list=transpose_2, index=excel_column_to_import_start_at)

# group: Update Parameters
parameter_to_update = StringInput("Cost")  # graph input
setParameterByName = Element.SetParameterByName(element=getItemAtIndex_2, parameterName=parameter_to_update, value=getItemAtIndex_3)

watch_2 = Watch(getItemAtIndex_2)
