# Dynamo graph ColumnCost-RVT2EXC.dyn "DFBP_01_Export Element Parameters to Excel" (Dynamo 2.0.2.6826)

# group: Get All Items
categories = Categories(index=496)  # graph input
all_elements_of_category = ElementsOfCategory(Category=categories)

# group: Sort Items By Selected Parameter
code_block = CodeBlock { "Mark"; }
getParameterValueByName = Element.GetParameterValueByName(parameterName=code_block)  # unwired: element
sortByFunction = List.SortByFunction(list=all_elements_of_category, func=getParameterValueByName)

# group: Get Items Instance Parameters
code_block_2 = CodeBlock { "Mark"; "Level"; "Cost"; }
getParameterValueByName_2 = Element.GetParameterValueByName(element=sortByFunction, parameterName=code_block_2.out0)
getParameterValueByName_3 = Element.GetParameterValueByName(element=sortByFunction, parameterName=code_block_2.out1)
name = Level.Name(level=getParameterValueByName_3)
name_2 = FamilyType.Name(familyType=sortByFunction)
getParameterValueByName_4 = Element.GetParameterValueByName(element=sortByFunction, parameterName=code_block_2.out2)

# group: Put the Parameter Values into a List
create = List.Create(item0=getParameterValueByName_2, item1=name, item2=name_2, item3=getParameterValueByName_4)
transpose = List.Transpose(lists=create)

# group: Add Column Headers for Excel
code_block_3 = CodeBlock { "Mark"; "Level"; "Type"; "Height"; "Width"; "Cost"; }
create_2 = List.Create(item0=code_block_3.out0, item1=code_block_3.out1, item2=code_block_3.out2, item3=code_block_3.out5)
addItemToFront = List.AddItemToFront(item=create_2, list=transpose)

# group: Export Data to Excel
file_path = Filename(".\Deneme.xslx")  # graph input
code_block_4 = CodeBlock { "Sheet 1"; 0; true; }
exportExcel = Data.ExportExcel(filePath=file_path, sheetName=code_block_4.out0, startRow=code_block_4.out1, startCol=code_block_4.out1, data=addItemToFront, overWrite=code_block_4.out2)

watch = Watch(addItemToFront)
